# Grasshopper definition RoadMap.gh (Grasshopper 0.9.14)
# plug-ins: Elk

path = FilePath("E:\Dropbox\Mathrioshka Project\SensoCamera\InfoModel\VVVVLayers\map2.osm")
loc = Location(Stream=Toggle(False), FilePString=path, LongitudeDomain=Domain(-1, 1), LatitudeDomain=Domain(-1, 1), Scale=10)  # -> OSMPointData, OSMData, LongitudeDomain, LatitudeDomain
majorroads = MajorRoads(OSMPointData=loc.OSMPointData, XMLData=loc.OSMData, CollectionType=0)  # -> Primary, PrimaryLinks, Secondary, SecondaryLinks, Tertiary, RoadKey
minorroads = MinorRoads(OSMPointData=loc.OSMPointData, XMLData=loc.OSMData, CollectionType=0)  # -> Residential, Unclassified, NotClassified, RoadKey
pline = PolyLine(Vertices=minorroads.Residential, Closed=False)
pline_2 = PolyLine(Vertices=minorroads.Unclassified, Closed=False)
pline_3 = PolyLine(Vertices=majorroads.Primary, Closed=False)
pline_4 = PolyLine(Vertices=majorroads.Secondary, Closed=False)
pline_5 = PolyLine(Vertices=majorroads.Tertiary, Closed=False)
merge = Merge(Data1=pline, Data2=pline_2, Data3=pline_3, Data4=pline_4, Data5=pline_5)  # -> flatten(Result)
crv = Curve(<curve referenced from the Rhino model>)
join = JoinCurves(Curves=merge, Preserve=False)
divlength = DivideLength(Curve=join, Length="0.4")  # -> Points, Tangents, Parameters
divlength_2 = DivideLength(Curve=crv, Length="0.4")  # -> Points, Tangents, Parameters
lng = ListLength(List=flatten(divlength.Points))
pcomp = Decompose(Point=flatten(divlength.Points), System=PlaneXY(0, 0, 0))  # -> XComponent, YComponent, ZComponent
lng_2 = ListLength(List=divlength.Points)  # -> flatten(Length)
lng_3 = ListLength(List=flatten(divlength_2.Points))
pcomp_2 = Decompose(Point=flatten(divlength_2.Points), System=PlaneXY(0, 0, 0))  # -> XComponent, YComponent, ZComponent
lng_4 = ListLength(List=divlength_2.Points)  # -> flatten(Length)
panel = Panel(lng)
panel_2 = Panel(lng_3)
panel_3 = Panel(pcomp.XComponent)
panel_4 = Panel(pcomp.YComponent)
panel_5 = Panel(pcomp_2.XComponent)
panel_6 = Panel(pcomp_2.YComponent)
panel_7 = Panel(lng_4)
panel_8 = Panel(lng_2)
